# Grasshopper definition parametricCoasterHolder.gh (Grasshopper 1.0.8)
# Copyright: MIT License vicdlsns / vdl149

materialthickness = Slider(3, range=0..10)
height = Slider(30, range=10..50)
insideradius = Slider(45, range=10..50)
holewidth = Slider(15, range=10..50)
cluster = Cluster(insideradius=insideradius, thickness=materialthickness, height=height, holewidth=holewidth)
geo = Geometry(cluster)

# ==== cluster Cluster
insideradius = ClusterInput()
thickness = ClusterInput()
height = ClusterInput()
holewidth = ClusterInput()

holewidth_2 = Number(holewidth)
height_2 = Number(height)
insideradius_2 = Number(insideradius)
thickness_2 = Number(thickness)

pt = ConstructPoint(XCoordinate=0, YCoordinate=0, ZCoordinate=0)
circle = CircleCNR(Center=pt, Normal=Vector(0, 0, 1), Radius=insideradius_2)
boundary = BoundarySurfaces(Edges=flatten(circle))
Z = UnitZ(Factor=thickness_2)
extr = Extrude(Base=boundary, Direction=Z)

pt_2 = ConstructPoint(XCoordinate=0, YCoordinate=0, ZCoordinate=height_2)
subtraction = Subtraction(A=height_2, B=thickness_2)
yz = YZPlane(Origin=pt_2)
ellipse = Ellipse(Plane=yz, Radius1=holewidth_2, Radius2=subtraction)  # -> Ellipse, Focus1, Focus2
addition = Addition(A=insideradius_2, B=thickness_2)
boundary_2 = BoundarySurfaces(Edges=ellipse.Ellipse)
X = UnitX(Factor=addition)
extr_2 = Extrude(Base=boundary_2, Direction=X)
arrpolar = PolarArray(Geometry=extr_2, Plane=PlaneXY(0, 0, 0), Count=Slider(4, range=1..4), Angle=6.283185307)  # -> Geometry, Transform

offset = OffsetCurve(Curve=circle, Distance=thickness_2, Corners=1)
boundary_3 = BoundarySurfaces(Edges=flatten([circle, offset]))
Z_2 = UnitZ(Factor=height_2)
extr_3 = Extrude(Base=boundary_3, Direction=Z_2)

sunion = SolidUnion(Breps=[extr, extr_3])

sdiff = SolidDifference(BrepsA=sunion, BrepsB=arrpolar.Geometry)

R = ClusterOutput(sdiff)
