# Grasshopper definition parametricCupholderScrew.gh (Grasshopper 1.0.8)

# ----
# Handle
handleheight = Slider(55, range=0..100)
screwholeheight = Slider(35, range=0..100)
handlewidth = Slider(54, range=0..100)
handledistancering = Slider(5, range=1..100)
handledepth = Slider(3, range=0..100)
screwholediameter = Slider(7, range=0..10)
filletradius = Slider(10, range=0..30)

# ----
# Base
# Doubleclick to change
basedistance = Slider(50, range=0..250)
basewidth = Slider(5, range=0..10)
usebase = BooleanToggle(False)

# ----
# Ring
ringheight = Slider(15, range=0..100)
innerdiameter = Slider(80, range=0..100)
# - All units are the same as your Rhino settings
# - Use sliders to set the dimensions as you wish
# - When finished, click on the "geo" component at the end, right-click it, then "Bake" and "Ok"
# Copyright (c) 2025 vicdlsns/vdl149
# MIT License
# https://github.com/vicdlsns
outerdiameter = Slider(85, range=0..100)

parametric_cupholder = ParametricCupholder(
    outerdiameter=outerdiameter,
    innerdiameter=innerdiameter,
    ringheight=ringheight,
    handlewidth=handlewidth,
    handledistancering=handledistancering,
    handledepth=handledepth,
    handleheight=handleheight,
    filletradius=filletradius,
    screwholediameter=screwholediameter,
    screwholeheight=screwholeheight,
    usebase=usebase,
    basewidth=basewidth,
    basedistance=basedistance)
geo = Geometry(parametric_cupholder)

# ==== cluster ParametricCupholder
handledistancering = ClusterInput()
usebase = ClusterInput()
basewidth = ClusterInput()
basedistance = ClusterInput()
handlewidth = ClusterInput()
screwholediameter = ClusterInput()
handledepth = ClusterInput()
screwholeheight = ClusterInput()
handleheight = ClusterInput()
filletradius = ClusterInput()

usebase_2 = Boolean(usebase)
basewidth_2 = Number(basewidth)
basedistance_2 = Number(basedistance)

handledistancering_2 = Number(handledistancering)
handlewidth_2 = Number(handlewidth)
screwholediameter_2 = Number(screwholediameter)
screwholeheight_2 = Number(screwholeheight)
handleheight_2 = Number(handleheight)
filletradius_2 = Number(filletradius)
handledepth_2 = Number(handledepth)

outerdiameter = ClusterInput()
ringheight = ClusterInput()
innerdiameter = ClusterInput()

outerdiameter_2 = Number(outerdiameter)
ringheight_2 = Number(ringheight)
innerdiameter_2 = Number(innerdiameter)

division = Division(A=innerdiameter_2, B=2)
cyl = Cylinder(Base=PlaneXY(0, 0, 0), Radius=division, Length=ringheight_2)
cap = CapHoles(Brep=cyl)

division_2 = Division(A=outerdiameter_2, B=2)
cyl_2 = Cylinder(Base=PlaneXY(0, 0, 0), Radius=division_2, Length=ringheight_2)
cap_2 = CapHoles(Brep=cyl_2)

# ----
# Auxiliar box
division_3 = Division(A=handlewidth_2, B=2)
division_4 = Division(A=ringheight_2, B=2)
box = CenterBox(Base=PlaneXY(0, 0, 0), X=division_2, Y=division_3, Z=division_4)
subtraction = Subtraction(A=division, B=division)
Z = UnitZ(Factor=division_4)
X = UnitX(Factor=subtraction)
move = Move(Geometry=box, Motion=Z)  # -> Geometry, Transform
move_2 = Move(Geometry=move.Geometry, Motion=X)  # -> Geometry, Transform
debrep = DeconstructBrep(Brep=move_2.Geometry)  # -> Faces, Edges, Vertices

# ----
# Screw hole
division_5 = Division(A=screwholediameter_2, B=2)
addition = Addition(A=division_2, B=handledistancering_2)
addition_2 = Addition(A=ringheight_2, B=screwholeheight_2)
cyl_3 = Cylinder(Base=PlaneXY(0, 0, 0), Radius=division_5, Length=handledepth_2)
cap_3 = CapHoles(Brep=cyl_3)
Z_2 = UnitZ(Factor=addition_2)
rotate = RotateDirection(Geometry=cap_3, Center=Point(0, 0, 0), From=Vector(1, 0, 0), To=unitize(Vector(0, 0, -52.37519789)))  # -> Geometry, Transform
X_2 = UnitX(Factor=addition)
move_3 = Move(Geometry=rotate.Geometry, Motion=X_2)  # -> Geometry, Transform
move_4 = Move(Geometry=move_3.Geometry, Motion=Z_2)  # -> Geometry, Transform

# ----
# Ring
sdiff = SolidDifference(BrepsA=cap_2, BrepsB=cap)

item = ListItem(List=debrep.Faces, Index=1, Wrap=True)
X_3 = UnitX(Factor=handledistancering_2)
extr = Extrude(Base=item, Direction=X_3)

debrep_2 = DeconstructBrep(Brep=extr)  # -> Faces, Edges, Vertices
item_2 = ListItem(List=debrep_2.Faces, Index=5, Wrap=True)
X_4 = UnitX(Factor=handledepth_2)
extr_2 = Extrude(Base=item_2, Direction=X_4)

Z_3 = UnitZ(Factor=handleheight_2)
debrep_3 = DeconstructBrep(Brep=extr_2)  # -> Faces, Edges, Vertices
item_3 = ListItem(List=debrep_3.Faces, Index=2, Wrap=True)
extr_3 = Extrude(Base=item_3, Direction=Z_3)
filedge = FilletEdge(Shape=extr_3, Blend=0, Metric=0, Edges=[6, 11], Radii=filletradius_2)

cyl_4 = Cylinder(Base=PlaneXY(0, 0, 0), Radius=division_2, Length=basewidth_2)
Z_4 = UnitZ(Factor=expr("-x", basedistance_2))
cap_4 = CapHoles(Brep=cyl_4)
move_5 = Move(Geometry=cap_4, Motion=Z_4)  # -> Geometry, Transform

# ----
# Handle
geo = Geometry([extr, filedge, extr_2])

sdiff_2 = SolidDifference(BrepsA=move_2.Geometry, BrepsB=cap)
item_4 = ListItem(List=sdiff_2, Index=0, Wrap=True)

debrep_4 = DeconstructBrep(Brep=item_4)  # -> Faces, Edges, Vertices
item_5 = ListItem(List=debrep_4.Faces, Index=4, Wrap=True)
Z_5 = UnitZ(Factor=expr("-x", basedistance_2))
addition_3 = Addition(A=handledistancering_2, B=handledepth_2)
extr_4 = Extrude(Base=item_5, Direction=Z_5)
X_5 = UnitX(Factor=addition_3)
debrep_5 = DeconstructBrep(Brep=extr_4)  # -> Faces, Edges, Vertices
item_6 = ListItem(List=debrep_5.Faces, Index=2, Wrap=True)
extr_5 = Extrude(Base=item_6, Direction=X_5)

# ----
# Base
geo_2 = Geometry([move_5.Geometry, extr_4, extr_5])
filter = StreamFilter(Gate=usebase_2, Stream1=geo_2)  # -> flatten(Stream)

sunion = SolidUnion(Breps=flatten([geo, sdiff, filter, item_4]))
sdiff_3 = SolidDifference(BrepsA=sunion, BrepsB=move_4.Geometry)

R = ClusterOutput(sdiff_3)
