# Grasshopper definition parametricSpool.gh (Grasshopper 1.0.8)
# Copyright: MIT License vicdlsns / vdl149

numberendholes = Slider(15, range=2..20)
# If not needed, set to 0
startendholediameter = Slider(2, range=0..4)
thickness = Slider(3, range=2..5)
borderdiameter = Slider(150, range=50..300)
height = Slider(100, range=50..300)
# - All units are the same as your Rhino settings
# - Use sliders to set the dimensions as you wish
# - When finished, click on the "geo" component at the end, right-click it, then "Bake" and "Ok"
# Copyright (c) 2025 vicdlsns/vdl149
# MIT License
# https://github.com/vicdlsns
holediameter = Slider(30, range=10..50)
cluster = Cluster(
    holediameter=holediameter,
    height=height,
    thickness=thickness,
    borderdiameter=borderdiameter,
    startendholediameter=startendholediameter,
    numberendholes=numberendholes)
geo = Geometry(cluster)

# ==== cluster Cluster
thickness = ClusterInput()
height = ClusterInput()
holediameter = ClusterInput()
borderdiameter = ClusterInput()
startendholediameter = ClusterInput()
numberendholes = ClusterInput()

startendholediameter_2 = Number(startendholediameter)
numberendholes_2 = Number(numberendholes)

holediameter_2 = Number(holediameter)
borderdiameter_2 = Number(borderdiameter)
thickness_2 = Number(thickness)
height_2 = Number(height)

division = Division(A=borderdiameter_2, B=2)
division_2 = Division(A=holediameter_2, B=2)
division_3 = Division(A=startendholediameter_2, B=2)

# ----
# Middle
addition = Addition(A=division_2, B=thickness_2)
cyl = Cylinder(Base=PlaneXY(0, 0, 0), Radius=addition, Length=height_2)
cap = CapHoles(Brep=cyl)

# ----
# Borders
cyl_2 = Cylinder(Base=PlaneXY(0, 0, 0), Radius=division, Length=thickness_2)
Z = UnitZ(Factor=height_2)
move = Move(Geometry=cyl_2, Motion=Z)  # -> Geometry, Transform
cap_2 = CapHoles(Brep=move.Geometry)
cap_3 = CapHoles(Brep=cyl_2)

# ----
# Main hole
addition_2 = Addition(A=height_2, B=thickness_2, C=thickness_2)
cyl_3 = Cylinder(Base=PlaneXY(0, 0, 0), Radius=division_2, Length=addition_2)
cap_4 = CapHoles(Brep=cyl_3)

# ----
# Start hole
addition_3 = Addition(A=height_2, B=thickness_2, C=thickness_2)
addition_4 = Addition(A=division_2, B=thickness_2, C=division_3)
cyl_4 = Cylinder(Base=PlaneXY(0, 0, 0), Radius=division_3, Length=addition_3)
cap_5 = CapHoles(Brep=cyl_4)
X = UnitX(Factor=addition_4)
move_2 = Move(Geometry=cap_5, Motion=X)  # -> Geometry, Transform

# ----
# End holes
subtraction = Subtraction(A=division, B=division_3, C=thickness_2)
X_2 = UnitX(Factor=subtraction)
move_3 = Move(Geometry=cap_5, Motion=X_2)  # -> Geometry, Transform
arrpolar = PolarArray(Geometry=move_3.Geometry, Plane=PlaneXY(0, 0, 0), Count=numberendholes_2, Angle=6.283185307)  # -> Geometry, Transform

sunion = SolidUnion(Breps=[cap, cap_3, cap_2])
sdiff = SolidDifference(BrepsA=sunion, BrepsB=cap_4)
sdiff_2 = SolidDifference(BrepsA=sdiff, BrepsB=move_2.Geometry)
sdiff_3 = SolidDifference(BrepsA=sdiff_2, BrepsB=arrpolar.Geometry)

R = ClusterOutput(sdiff_3)
